# Dynamo graph panda.dyn (Dynamo 2.0.2.6826)

code_block = CodeBlock { {"one's":[1,11,111,11,1],"two's":[2,22,222,22,2],"three's":[3,33,333,33,3],"four's":[4,44,444,44,4]}; }
code_block_2 = CodeBlock { {"model":["Lisa","Lisa 2","Macintosh 128K","Macintosh 512K"],"launched":[1983,1984,1984,1984],"discontinued":[1986,1985,1984,1986]}; }
code_block_3 = CodeBlock()
# ---------- code_block_3.designscript (2 lines) ----------
["model","launched","discontinued"];
[["Lisa","Lisa 2","Macintosh 128K","Macintosh 512K"],[1983,1984,1984,1984],[1986,1985,1984,1986]];
# ----------------------------------------
byKeysValues = DesignScript.Builtin.Dictionary.ByKeysValues(keys=code_block_3.out0, values=code_block_3.out1)
keys = DesignScript.Builtin.Dictionary.Keys(dictionary=code_block_2)
reverse = List.Reverse(list=keys)
values = DesignScript.Builtin.Dictionary.Values(dictionary=code_block_2)
reverse_2 = List.Reverse(list=values)
file_path = Filename(".\movies.xls")
code_block_4 = CodeBlock { "2010s"; }

# group: Create Dataframe
byDictionary = DynamoPandas.Pandas.DataFrame.ByDictionary(dataDictionary=code_block_2)
code_block_5 = CodeBlock(x=byDictionary) { x; }  # frozen
dataFrameJson = DynamoPandas.Pandas.DataFrame.DataFrameJson(dataFrame=code_block_5)
tabulate = DynamoPandas.Format.DataFrameFormatters.Tabulate(dataframe=byDictionary)
toDictionary = DynamoPandas.Pandas.DataFrame.ToDictionary(dataFrame=code_block_5)
byColumnsValues = DynamoPandas.Pandas.DataFrame.ByColumnsValues(columns=reverse, values=reverse_2)
tabulate_2 = DynamoPandas.Format.DataFrameFormatters.Tabulate(dataframe=byColumnsValues)
byExcel = DynamoPandas.Pandas.DataFrame.ByExcel(filePath=file_path, sheetName=code_block_4)

# group: Select Rows
code_block_6 = CodeBlock { "model"; "Lisa"; }
byMatch = DynamoPandas.Select.SelectRows.ByMatch(dataframe=code_block_5, column=code_block_6.out0, matchString=code_block_6.out1)
tabulate_3 = DynamoPandas.Format.DataFrameFormatters.Tabulate(dataframe=byMatch)

code_block_7 = CodeBlock(x=byExcel) { x; }  # frozen
tabulate_4 = DataframeTableNodeModel(Dataframe=code_block_7)

# group: Filters
code_block_8 = CodeBlock { "Actor"; 1; }
byContains = DynamoPandas.FilterDataframe.Filter.ByContains(dataframe=code_block_7, item=code_block_8.out0, axis=code_block_8.out1)
code_block_9 = CodeBlock { "Budget"; 1; }
byItems = DynamoPandas.FilterDataframe.Filter.ByItems(dataframe=code_block_7, items=code_block_9.out0, axis=code_block_9.out1)

# group: Get columns containing Actor
tabulate_5 = DataframeTableNodeModel(Dataframe=byContains)

tabulate_6 = DataframeTableNodeModel(Dataframe=byItems)

# group: Get rows containing Ryan
code_block_10 = CodeBlock { "Actor 1"; "Ryan"; }
byContains_2 = DynamoPandas.Select.SelectRows.ByContains(dataframe=byContains, column=code_block_10.out0, containsString=code_block_10.out1)
tabulate_7 = DataframeTableNodeModel(Dataframe=byContains_2)

code_block_11 = CodeBlock { ["model"]; ["launched","discontinued"]; }
melt = DynamoPandas.Reshape.ReshapeDataframe.Melt(dataframe=byColumnsValues, idVar=code_block_11.out0, valueVar=code_block_11.out1)
tabulate_8 = DynamoPandas.Format.DataFrameFormatters.Tabulate(dataframe=melt)
code_block_12 = CodeBlock { "model"; "launched"; ["discontinued"]; }
pivot = DynamoPandas.Reshape.ReshapeDataframe.Pivot(dataframe=byDictionary, index=code_block_12.out1, columns=code_block_12.out0, values=code_block_12.out2)
tabulate_9 = DynamoPandas.Format.DataFrameFormatters.Tabulate(dataframe=pivot)
code_block_13 = CodeBlock { ["model"]; ["new_models"]; }
renameColumns = DynamoPandas.Reshape.ReshapeDataframe.RenameColumns(dataframe=byDictionary, oldValues=code_block_13.out0, newValues=code_block_13.out1)
tabulate_10 = DynamoPandas.Format.DataFrameFormatters.Tabulate(dataframe=renameColumns)
code_block_14 = CodeBlock { true; }
sortValues = DynamoPandas.Reshape.ReshapeDataframe.SortValues(dataframe=byDictionary, columns=code_block_12.out2, ascending=code_block_14)
tabulate_11 = DynamoPandas.Format.DataFrameFormatters.Tabulate(dataframe=sortValues)
